# Grasshopper definition CheckParameter.gh (Grasshopper 1.0.7)
# plug-ins: Pterodactyl

number_slider = Slider(0.36, range=0..1)
number_slider_2 = Slider(0.42, range=0..1)
angle = Slider(45, range=0..360)
t3 = Slider(0.25, range=0..1)
writefile = BooleanToggle(False)
maxnum = Panel("100")
l2_curve = Curve(<curve referenced from the Rhino model>)
l3_curve = Curve(<curve referenced from the Rhino model>)
path = FilePath("C:\Users\admin\Desktop\")
l1_curve = Curve(<curve referenced from the Rhino model>)
fix_center = CSharpScript(WriteFile=writefile, maxNum=maxnum, l1=l1_curve, l2=l2_curve, t2=number_slider_2, l3=l3_curve, t3=t3, fp=path)  # -> out, X; inputs WriteFile: Boolean, maxNum: Int32, l1: Line, l2: Line, t2: Double, l3: Line, t3: Double, fp: String
# ---------- fix_center: C# usings ----------
using System.IO;
# ---------- fix_center: C# ----------
    if(!WriteFile)return;
    string fileName = fp + "FixCenter.csv";
    using (FileStream fs = File.Create(fileName)){
      using (StreamWriter sw = new StreamWriter(fs)){
        sw.Write("x,a,beta,k,phi\n");
        Vector3d axis = _l2.Direction;
        Point3d p3 = _l3.PointAt(t3), p2 = _l2.PointAt(t2);

        for(int i = 1; i < maxNum; i++){
          double t1 = (double) i / (double) maxNum;
          Point3d p1 = _l1.PointAt(t1);
          for(int j = 0; j < maxNum; j++){
            double a = (double) j / (double) maxNum * 2 * Math.PI;
            Vector3d e = new Vector3d(p1 - p2), e2 = new Vector3d(p3 - p2);
            double phi3 = Vector3d.VectorAngle(e2, axis), phi4 = Vector3d.VectorAngle(e, axis);
            double k = 2 * Math.PI - phi3 - phi4, beta = Vector3d.VectorAngle(e, e2);
            double phi1 = Math.Atan2(Math.Cos(k) - Math.Cos(beta), Math.Sin(beta) * Math.Cos(a) - Math.Sin(k));
            if(phi1 < 0) phi1 += Math.PI;
            sw.Write(((double) i / (double) maxNum).ToString() + "," + a.ToString() + "," + beta.ToString() + "," +
              k.ToString() + "," + phi1.ToString() + "\n");
          }
        }
      }
    }
# ---------- end fix_center ----------
fix_angle = CSharpScript(WriteFile=writefile, maxNum=maxnum, l1=l1_curve, l2=l2_curve, l3=l3_curve, t3=t3, angle=angle, fp=path)  # -> out, X; inputs WriteFile: Boolean, maxNum: Int32, l1: Line, l2: Line, l3: Line, t3: Double, angle: Double, fp: String
# ---------- fix_angle: C# usings ----------
using System.IO;
using System.Text;
# ---------- fix_angle: C# ----------
    if(!WriteFile)return;
    var fileName = fp + "FixAngle.csv";
    using (FileStream fs = File.Create(fileName)){
      using (StreamWriter sw = new StreamWriter(fs)){
        sw.Write("x,y,beta,k,phi\n");
        Vector3d axis = -_l2.Direction;
        double a = angle * Math.PI / 360.0;
        Point3d p3 = _l3.PointAt(t3);

        for(int i = 1; i < maxNum; i++){
          double t1 = (double) i / (double) maxNum;
          Point3d p1 = _l1.PointAt(t1);
          for(int j = 1; j < maxNum; j++){
            double t2 = (double) j / (double) maxNum;
            Point3d p2 = _l2.PointAt(t2);
            Vector3d e = new Vector3d(p1 - p2), e2 = new Vector3d(p3 - p2);
            double phi3 = Vector3d.VectorAngle(e2, axis), phi4 = Vector3d.VectorAngle(e, axis);
            double k = 2 * Math.PI - phi3 - phi4, beta = Vector3d.VectorAngle(e, e2);
            double phi1 = Math.Atan2(Math.Cos(k) - Math.Cos(beta), Math.Sin(beta) * Math.Cos(a) - Math.Sin(k));
            if(phi1 < 0) phi1 += Math.PI;
            sw.Write(((double) i / (double) maxNum).ToString() + "," + ((double) j / (double) maxNum).ToString() + "," +
              beta.ToString() + "," + k.ToString() + "," + phi1.ToString() + "\n");
          }

        }
      }
    }
# ---------- end fix_angle ----------
fix_end = CSharpScript(WriteFile=writefile, maxNum=maxnum, t1=number_slider, t3=t3, fp=path)  # -> out, X; inputs WriteFile: Boolean, maxNum: Int32, l1: Line, t1: Double, l2: Line, l3: Line, t3: Double, fp: String
# ---------- fix_end: C# ----------
    string fileName = fp + "FixEnd.csv";
    using (FileStream fs = File.Create(fileName)){
      using (StreamWriter sw = new StreamWriter(fs)){
        sw.Write("x,y,beta,k,phi\n");
        Vector3d axis = -_l2.Direction;
        Point3d p3 = _l3.PointAt(t3), p1 = _l1.PointAt(t1);

        for(int i = 1; i < maxNum; i++){
          double t2 = (double) i / (double) maxNum;
          Point3d p2 = _l2.PointAt(t2);
          for(int j = 0; j < maxNum; j++){
            double a = (double) j / (double) maxNum * 2 * Math.PI;
            Vector3d e = new Vector3d(p1 - p2), e2 = new Vector3d(p3 - p2);
            double phi3 = Vector3d.VectorAngle(e2, axis), phi4 = Vector3d.VectorAngle(e, axis);
            double k = 2 * Math.PI - phi3 - phi4, beta = Vector3d.VectorAngle(e, e2);
            double phi1 = Math.Atan2(Math.Cos(k) - Math.Cos(beta), Math.Sin(beta) * Math.Cos(a) - Math.Sin(k));
            if(phi1 < 0) phi1 += Math.PI;
            sw.Write(((double) i / (double) maxNum).ToString() + "," + a.ToString() + "," + beta.ToString() + "," +
              k.ToString() + "," + phi1.ToString() + "\n");
          }

        }
      }
    }
# ---------- end fix_end ----------
c_script = CSharpScript(l1=l1_curve, t1=number_slider, l2=l2_curve, t2=number_slider_2, l3=l3_curve, t3=t3, a=angle, fp=path)  # -> out, Points, Edges, beta, k, phi; inputs l1: Line, t1: Double, l2: Line, t2: Double, l3: Line, t3: Double, a: Double, fp: String
# ---------- c_script: C# ----------
    var _P = new List<Point3d>();
    var _E = new List<Line>();
    double _a = a * Math.PI / 180.0;

    Point3d _p1 = l1.PointAt(t1), _p2 = l2.PointAt(t2), _p3 = l3.PointAt(t3);
    Vector3d e = new Vector3d(_p1 - _p2), e2 = new Vector3d(_p3 - _p2);
    Vector3d axis = -l2.Direction;
    double phi4 = Vector3d.VectorAngle(e, axis), phi3 = Vector3d.VectorAngle(e2, axis);
    double _k = 2.0 * Math.PI - phi4 - phi3;
    double b = Vector3d.VectorAngle(e, e2);//betaの計算
    double _phi = Math.Atan2(Math.Cos(_k) - Math.Cos(b), Math.Sin(b) * Math.Cos(_a) - Math.Sin(_k));
    if(_phi < 0)_phi += Math.PI;
    
    _E.Add(new Line(_p2, _p1)); _E.Add(new Line(_p2, _p3));
    _P.Add(_p1); _P.Add(_p2); _P.Add(_p3);
    Points = _P; Edges = _E; beta = b; k = _k; phi = _phi;
# ---------- end c_script ----------
panel = Panel([c_script.beta, c_script.k, c_script.phi])
pt = Point(c_script.Points)
line = Line(c_script.Edges)
series = Series(Start=0, Step=1, Count=10)
gradient = Gradient(LowerLimit=0, UpperLimit=1, Parameter=series, stops=[0.15: RGB(255, 130, 160), 0.85: RGB(220, 0, 40)])
graph_legend = GraphLegend(Title="Legend", Position=0, Placement=0, Orientation=1, TextSize=12)
scatter_data = ScatterData(Marker=1, ColorPalette=gradient)
graph_data = GraphData(DataTypes=scatter_data)
graph_settings = GraphSettings(Title="Title", Background=RGB(255, 255, 255), GraphPadding=8, TitleSize=18)
graph_elements = GraphElements(GraphData=graph_data, GraphLegend=graph_legend)
graph = Graph(ShowGraph=False, GraphElements=graph_elements, GraphSettings=graph_settings, Path=path)
