# Grasshopper definition Draw_4DV.gh (Grasshopper 1.0.7)

rad = Slider(11.216, range=0..100)
foldangle = Slider(42.416, range=-180..180)
flap_angle = Slider(100.235, range=0..360)
phi4 = Slider(106.844, range=0..360)
k = Slider(195.21, range=0..360)
move = Panel("50,0,0")
center = Panel("0,0,0")
c_script = CSharpScript(k=k, phi4=phi4, rad=rad)  # -> out, Edges, len; inputs k: Double, phi4: Double, rad: Double
# ---------- c_script: C# ----------
    if(k < 5 || k >= 355 || 360 - k < phi4)return;
    double _k = Math.PI * k / 180.0;
    double _phi4 = Math.PI * phi4 / 180.0;
    var _Edges = new List<Vector3d>();
    Rhino.Geometry.Point3d center = new Rhino.Geometry.Point3d(0, 0, 0);
    Rhino.Geometry.Vector3d e = new Rhino.Geometry.Vector3d(rad, 0, 0);

    var R = Rhino.Geometry.Transform.Rotation(_k, center);
    var e2 = R * e;
    var R_axis = Rhino.Geometry.Transform.Rotation(-_phi4, center);
    var axis = R_axis * e;
    _Edges.Add(axis);  _Edges.Add(e); _Edges.Add(e2);
    len = _Edges.Count;
    Edges = _Edges;
# ---------- end c_script ----------
cir = Circle(Plane=PlaneXY(0, 0, 0), Radius=rad)
c_script_2 = CSharpScript(Edges=c_script.Edges, FoldAngle=foldangle)  # -> out, Edges_3D; inputs Edges: list of Vector3d, FoldAngle: Double
# ---------- c_script_2: C# ----------
    if(Edges.Count == 0)return;
    double a = Math.PI * FoldAngle / 180.0;
    var _Edges = Edges;
    Rhino.Geometry.Point3d center = new Rhino.Geometry.Point3d(0, 0, 0);
    Rhino.Geometry.Vector3d e = Edges[1], axis = Edges[0];

    var R = Rhino.Geometry.Transform.Rotation(a, -axis, center);
    Edges[2] = R * Edges[2];
    Edges_3D = _Edges;
# ---------- end c_script_2 ----------

# ---- group: Vector Display
range = Range(Domain=c_script.len, Steps=c_script.len)
item = ListItem(List=c_script.Edges, Index=range, Wrap=True)
vdis = VectorDisplay(Anchor=center, Vector=item)

range_2 = Range(Domain=c_script.len, Steps=c_script.len)
item_2 = ListItem(List=c_script_2.Edges_3D, Index=range_2, Wrap=True)
vdis_2 = VectorDisplay(Anchor=move, Vector=c_script_2.Edges_3D)

# ---- group: Draw Great Circle
c_script_3 = CSharpScript(Edges=c_script_2.Edges_3D)  # -> out, GreatCircle; inputs Edges: list of Vector3d
# ---------- c_script_3: C# ----------
    var GC = new List<Circle>();
    int n = Edges.Count;
    Rhino.Geometry.Point3d o = new Rhino.Geometry.Point3d(0, 0, 0);
    for(int i = 0; i < n; i++){
      double r = Edges[i].Length;
      var N = Vector3d.CrossProduct(Edges[i],Edges[(i + 1) % n]);
      Rhino.Geometry.Plane P = new Rhino.Geometry.Plane(o, N); 
      Rhino.Geometry.Circle C = new Rhino.Geometry.Circle(P, r);
      GC.Add(C);
    }
    GreatCircle = GC;
# ---------- end c_script_3 ----------
move_2 = Move(Geometry=c_script_3.GreatCircle, Motion=move)  # -> Geometry, Transform

# ----
c_script_4 = CSharpScript(Edges=c_script_2.Edges_3D, k=k, a=flap_angle, center=center)  # -> out, Edges_4; inputs Edges: list of Vector3d, k: Double, a: Double, center: Point3d
# ---------- c_script_4: C# ----------
    var res = Edges;
    double _k = k * Math.PI / 180.0;
    double _a = a * Math.PI / 180.0;

    double beta = Vector3d.VectorAngle(Edges[1], Edges[2]);
    double phi4 = Vector3d.VectorAngle(Edges[1], Edges[0]), phi3 = Vector3d.VectorAngle(Edges[0], Edges[2]);
    double phi1 = Math.Atan2(Math.Cos(_k) - Math.Cos(beta), Math.Sin(beta) * Math.Cos(_a) - Math.Sin(_k));
    if(phi1 < 0)phi1 += Math.PI;

    var N = Vector3d.CrossProduct(Edges[1], Edges[2]);
    var R_a = Rhino.Geometry.Transform.Rotation(_a, -Edges[1], center);
    N = R_a * N;
    var R_phi = Rhino.Geometry.Transform.Rotation(phi1, N, center);
    var r = R_phi * Edges[1];
    res.Add(r);
    Edges_4 = res;
# ---------- end c_script_4 ----------

# ---- group: Vector Display / 4Degree Vertices
range_3 = Range(Domain=Domain(0, 3), Steps=3)
item_3 = ListItem(List=c_script_4.Edges_4, Index=range_3, Wrap=True)
vdis_3 = VectorDisplay(Anchor=move, Vector=c_script_4.Edges_4)

# ----
c_script_5 = CSharpScript()  # -> Out, Faces
