# Grasshopper definition PillowBox.gh (Grasshopper 1.0.7)

divide = Slider(10, range=5..20)
number_slider = Slider(40, range=10..40)
point1 = Point(<point referenced from the Rhino model>)
point2 = Point(<point referenced from the Rhino model>)
rectangle = Rectangle(Plane=PlaneXY(0, 0, 0), XSize=number_slider, YSize=Slider(40, range=10..40), Radius=0)  # -> Rectangle, Length
cp = ControlPoints(Curve=rectangle.Rectangle)  # -> Outline, Weights, Knots
width_scale = Slider(0.726, range=0.1..1)
genes = GenePool(Decimals=2, Maximum=100, Minimum=0, Value=[50, 50])
input_curve = CSharpScript(P=cp.Outline, N=divide, p1=point1, p2=point2)  # -> out, Points2d, Bezier2d, K_ori; inputs P: list of Point3d, N: Int32, p1: Point3d, p2: Point3d
# ---------- input_curve: C# ----------
List<Point3d> CP2d = new List<Point3d>();
List<Point3d> BP2d = new List<Point3d>();
List<double> K = new List<double>();
Vector3d Axis = new Vector3d(0,1,0);
Point3d p0 = P[0],  p3 = P[1];

CP2d.Add(new Point3d(P[0])); CP2d.Add(p1); CP2d.Add(p2); CP2d.Add(new Point3d(P[1]));

for(int n = 0; n < N; n++){
    double t = (double) n / (double) (N - 1);
    BP2d.Add(bezier(t, CP2d));
}

for(int i = 1; i < N - 1; i++){
    Vector3d e = new Vector3d(BP2d[i-1] - BP2d[i]); e.Unitize();
    Vector3d e2 = new Vector3d(BP2d[i+1] - BP2d[i]); e.Unitize();
    double k = 2 * Math.PI - Math.Abs(Vector3d.VectorAngle(e, Axis)) - Math.Abs(Vector3d.VectorAngle(e2, Axis));

    K.Add(k);
}

Points2d = CP2d; Bezier2d = BP2d; K_ori = K;
# ---------- input_curve: C# additional code ----------
  double fact(int n){
    if(n <= 1)return 1;
    return (double)n * fact(n - 1);
}

double cmb(int n, int k){return fact(n) / (fact(k) * fact(n - k));}

Point3d bezier(double t, List<Point3d> CP){
    Point3d p = new Point3d(0,0,0);
    for(int i = 0; i < 4; i++)p += cmb(3, i) * Math.Pow(1.0 - t, 3 - i) * Math.Pow(t, i) * CP[i];
    return p;
}
# ---------- end input_curve ----------
a = Slider(244.924, range=0..360)
projection_on_circle = CSharpScript(P=input_curve.Bezier2d, x=number_slider, N=divide, wc=width_scale)  # -> out, Bezier3d, center; inputs P: list of Point3d, x: Double, N: Int32, wc: Double
# ---------- projection_on_circle: C# usings ----------
using System.Linq;
# ---------- projection_on_circle: C# ----------
if(P.Count == 0)return;
List<Point3d> _Pprj = new List<Point3d>();
if(wc < 1){
    double phi = 2.0*(1.0 - wc) * Math.PI;
    double _r = x/phi;

    double _a = _r * Math.Sin(phi/2.0), _b = _r * Math.Cos(phi/2.0);
    Point3d c = new Point3d(P[0].X + _a, 0, P[0].Z - _b);
    double lt, phit;
    for(int i = 0; i < N; i++){
        lt = (double)i/(double)(N-1) * x;
        phit = lt/_r;
        Vector3d v = new Vector3d(P[0] - c);
        v.Rotate(phit, new Vector3d(0,1,0));
        _Pprj.Add(new Point3d(v.X + c.X, P[i].Y, v.Z + c.Z));
    }
    center = c;
}else{
    foreach(Point3d p in P)_Pprj.Add(new Point3d(p));
}


Bezier3d = _Pprj;
# ---------- end projection_on_circle ----------
error_2_dicrete_curve = CSharpScript(Bezier2d=input_curve.Bezier2d, Bezier3d=projection_on_circle.Bezier3d)  # -> out, E_iso, E_sim; inputs Bezier2d: list of Point3d, Bezier3d: list of Point3d
# ---------- error_2_dicrete_curve: C# ----------
double e_len = 0.0, e_k = 0.0;

for(int i = 0; i < Bezier3d.Count - 1; i++)
e_len += Math.Abs(Bezier2d[i].DistanceTo(Bezier2d[i+1]) - Bezier3d[i].DistanceTo(Bezier3d[i+1]));

for(int i = 1; i < Bezier3d.Count - 1; i++)
e_k += Math.Abs(getK(Bezier2d[i], Bezier2d[i-1], Bezier2d[i+1]) - getK(Bezier3d[i], Bezier3d[i-1], Bezier3d[i+1]));

E_iso = e_len; E_sim = e_k;
# ---------- error_2_dicrete_curve: C# additional code ----------
double getK(Point3d o, Point3d x, Point3d x2){
    Vector3d Y = new Vector3d(0,1,0);
    Vector3d e = new Vector3d(x - o), e2 = new Vector3d(x2 - o); e.Unitize(); e2.Unitize();
    return 2.0 * Math.PI - Vector3d.VectorAngle(e, Y) - Vector3d.VectorAngle(e2, Y);
}
# ---------- end error_2_dicrete_curve ----------
rad = Radians(Degrees=a)
generate_rulings_directions = CSharpScript(Bezier3d=projection_on_circle.Bezier3d, Bezier2d=input_curve.Bezier2d, a=rad)  # -> out, K, Beta, Theta, Normals, Rulings3d, Rulings2d, Tau, A; inputs Bezier3d: list of Point3d, Bezier2d: list of Point3d, a: Double; same code as generate_rulings_directions
getcrosspoints = CSharpScript(
    Outline=cp.Outline,
    Bezier2d=input_curve.Bezier2d,
    Bezier3d=projection_on_circle.Bezier3d,
    Rulings3d=generate_rulings_directions.Rulings3d,
    Rulings2d=generate_rulings_directions.Rulings2d)  # -> out, Line2d, Line3d, OnZplane; inputs Outline: list of Point3d, Bezier2d: list of Point3d, Bezier3d: list of Point3d, Rulings3d: list of Vector3d, Rulings2d: list of Vector3d; same code as getcrosspoints
num = Number(getcrosspoints.OnZplane)
line = Line(getcrosspoints.Line3d)
e_plane = CSharpScript(Line3d=getcrosspoints.Line3d)  # -> out, f; inputs Line3d: list of Line
# ---------- e_plane: C# ----------
double _f = 0.0;
foreach(Line l in Line3d){
    _f += Math.Abs(l.To.Z);
}
f = _f;
# ---------- end e_plane ----------
e_ruling = CSharpScript(Line2d=getcrosspoints.Line2d)  # -> out, f; inputs Line2d: list of Line
# ---------- e_ruling: C# ----------
double _f = 0.0;
double a,b;
for(int i = 0; i < Line2d.Count; i++){
    for(int j = -1; j <= 1; j += 2){
        int i2 = i + j;
        if(i2 < 0 || i2 >= Line2d.Count)continue;
        if(Rhino.Geometry.Intersect.Intersection.LineLine(Line2d[i], Line2d[i2], out a, out b)){
            if(0 <= b && b <= 1 && 0 <= a && a <= 1)_f += 1.0/b;
        }
    }
}
f = _f;
# ---------- end e_ruling ----------
num_2 = Number(e_ruling.f)
panel = Panel([num, num_2])

# ---- group: second optimzie scale to avoid ruling crossing
galapagos = Galapagos(fitness=num_2, gene=width_scale)

# ---- group: first optimize flap angle
galapagos_2 = Galapagos(fitness=num, gene=a)

# ---- group: value Ez of flap angle a from 0 to 2pi
cluster = Cluster(bezier3d=projection_on_circle.Bezier3d, outline=cp.Outline, bezier2d=input_curve.Bezier2d)  # -> onzplane, D
path = FilePath("/Users/nishizawa/Documents/RhinoScript/res.csv")
write_csv = GhPythonScript(IsWrite=Toggle(False), fileName=path, a=cluster.D, Ez=cluster.onzplane)  # -> out, a; inputs IsWrite: Boolean, a: list, Ez: list
# ---------- write_csv: Python ----------
__author__ = "nishizawa"

import rhinoscriptsyntax as rs
import csv
if IsWrite == True: 
    with open(fileName, 'w') as f:
        writer = csv.writer(f)
        for i in range(len(a)):
            writer.writerow([a[i], Ez[i]])
# ---------- end write_csv ----------

# ==== cluster Cluster
outline = ClusterInput()
bezier2d = ClusterInput()
bezier3d = ClusterInput()
iteration = Slider(500, range=10..1000)
pi = Pi(Factor=2)
dom = ConstructDomain(DomainStart=0, DomainEnd=pi)
range = Range(Domain=dom, Steps=iteration)
bezier2d_2 = Point(bezier2d)
bezier3d_2 = Point(bezier3d)
generate_rulings_directions = CSharpScript(Bezier3d=bezier3d_2, Bezier2d=bezier2d_2, a=range)  # -> out, K, Beta, Theta, Normals, Rulings3d, Rulings2d, Tau, A; inputs Bezier3d: list of Point3d, Bezier2d: list of Point3d, a: Double
# ---------- generate_rulings_directions: C# ----------
List<double> _K = new List<double>(), _B = new List<double>(), _T = new List<double>(), _Tau = new List<double>(), _A = new List<double>();
List<Vector3d> _Normals = new List<Vector3d>(), _Rulings3d = new List<Vector3d>();
List<Vector3d> _Rulings2d = new List<Vector3d>();
Vector3d Axis = new Vector3d(0,1,0);
Vector3d befN = new Vector3d(), N = new Vector3d();
Vector3d Z = new Vector3d(0,0,1);
double a2 = 0.0;

for(int i = 1; i < Bezier3d.Count - 1; i++){
    Vector3d e =  new Vector3d(Bezier3d[i-1] - Bezier3d[i]); e.Unitize();
    Vector3d e2 = new Vector3d(Bezier3d[i+1] - Bezier3d[i]); e2.Unitize();
    N = Vector3d.CrossProduct(e, e2); N.Unitize();
    if(i != 1){
        Vector3d SrfN = ProjectionVec(e, N);
        double tau = Math.Acos(Vector3d.Multiply(befN, SrfN));
        if(Vector3d.Multiply(e, Vector3d.CrossProduct(befN, SrfN)) < 0)tau = 2 * Math.PI - tau;
        a = a2 - tau;
        if(a < 0) a += 2 * Math.PI;
        _Tau.Add(tau);
    }
    double b = Vector3d.VectorAngle(e, e2);
    double k = 2 * Math.PI - Math.Abs(Vector3d.VectorAngle(e, Axis)) - Math.Abs(Vector3d.VectorAngle(e2, Axis));

    N.Rotate(a, e);
    double theta = Math.Atan2(Math.Cos(k) - Math.Cos(b), Math.Sin(b)* Math.Cos(a) - Math.Sin(k));
    if(theta < 0) theta += Math.PI;
    Vector3d r3d = new Vector3d(e); r3d.Rotate(theta, N);
    Vector3d r2d = new Vector3d(Bezier2d[i - 1] - Bezier2d[i]); r2d.Unitize(); r2d.Rotate(theta, Z);
    _Rulings2d.Add(r2d); _Rulings3d.Add(r3d);
    double sin_a = Math.Sin(a) * Math.Sin(theta)/Math.Sin(k - theta);
    double cos_a = (Math.Cos(theta) - Math.Cos(k - theta)*Math.Cos(b))/(Math.Sin(k - theta)*Math.Sin(b));
    a2 = Math.Atan(sin_a/cos_a);
    if(a2 < 0) a2 += 2 * Math.PI;
    befN = ProjectionVec(e2, Vector3d.CrossProduct(e, e2));  befN.Unitize();
    _K.Add(k); _B.Add(b); _Normals.Add(N); _A.Add(cos_a); _T.Add(theta*180.0/Math.PI);
}

K = _K; Beta = _B; Theta = _T; Rulings3d = _Rulings3d; Rulings2d = _Rulings2d; Normals = _Normals; Tau = _Tau; A = _A;
# ---------- generate_rulings_directions: C# additional code ----------
Vector3d ProjectionVec(Vector3d N, Vector3d v){
    N.Unitize();
    Vector3d V = new Vector3d(v - Vector3d.Multiply(Vector3d.Multiply(v,N), N));
    V.Unitize();
    return V;
}
# ---------- end generate_rulings_directions ----------
deg = Degrees(Radians=range)
D = ClusterOutput(deg)
getcrosspoints = CSharpScript(
    Outline=outline,
    Bezier2d=bezier2d_2,
    Bezier3d=bezier3d_2,
    Rulings3d=generate_rulings_directions.Rulings3d,
    Rulings2d=generate_rulings_directions.Rulings2d)  # -> out, Line2d, Line3d, flatten(OnZplane); inputs Outline: list of Point3d, Bezier2d: list of Point3d, Bezier3d: list of Point3d, Rulings3d: list of Vector3d, Rulings2d: list of Vector3d
# ---------- getcrosspoints: C# ----------
double len = 1000;
List<Line> L2d = new List<Line>();
List<Line> L3d = new List<Line>();
for(int i = 0; i < Rulings2d.Count; i++){
    Line la = new Line(Bezier2d[i+1], Rulings2d[i], len);
    for(int j = 0; j < Outline.Count - 1; j++){
        double a, b;
        Line lb = new Line(Outline[j], Outline[j+1]);
        if(Rhino.Geometry.Intersect.Intersection.LineLine(la, lb, out a, out b)){
            if(0 <= b && b <= 1 && 0 <= a && a <= 1){
                Point3d p2d = la.PointAt(a);
                L2d.Add(new Line(Bezier2d[i+1], p2d));
                Point3d p3d = p2d.DistanceTo(Bezier2d[i+1]) * Rulings3d[i] + Bezier3d[i+1];
                L3d.Add(new Line(Bezier3d[i+1], p3d));
            }
        }
    }
}

double dif_Z = Math.Abs(L3d[0].To.Z - Bezier2d[0].Z);
Line2d = L2d; Line3d = L3d; OnZplane = dif_Z;
# ---------- end getcrosspoints ----------
onzplane = ClusterOutput(getcrosspoints.OnZplane)
